# Grasshopper definition map.gh (Grasshopper 1.0.7)
# plug-ins: ShapeDiverForGrasshopper, Urbano, ClipperComponents, Bifocals, Triceratops

sddp = ShapeDiverDocumentPayload({AbsoluteTolerance=0, AngleTolerance=0, DistanceDisplayPrecision=0, GltfVersion="Gltf2", InputGroups="{}", OutputGroups="{}", RelativeTolerance=0, UnitSystem=0, VersionCreated="1.13.1.0", VersionSaved="1.13.1.0"})
assets_folder = FilePath("C:\Uni\2024\Term 2\CODE2132\sabri-web-page\web-page\assets\")

# ---- group: bbox coords
bbox_coords = FilePath("C:\Uni\2024\Term 2\CODE2132\sabri-web-page\web-page\assets\bbox.json")

# ---- group: point data
point_data = FilePath("C:\Uni\2024\Term 2\CODE2132\sabri-web-page\web-page\assets\point.json")

# ----
read_file = ReadFile(File=bbox_coords, PerLineParse=True)
panel = Panel("""0
-1""")
read_file_2 = ReadFile(File=point_data, PerLineParse=True)
cull_index = CullIndex(List=read_file, Indices=panel, Wrap=True)
panel_2 = Panel(read_file_2)
text_split = TextSplit(Text=cull_index, Separators=":")
panel_3 = Panel("""-1
0""")
cull_index_2 = CullIndex(List=panel_2, Indices=panel_3, Wrap=True)
cull_index_3 = CullIndex(List=text_split, Indices="0", Wrap=True)
replace_text = ReplaceText(Text=cull_index_3, Find="\"", RecursiveReplace=False)
text_split_2 = TextSplit(Text=cull_index_2, Separators=":")
text_split_3 = TextSplit(Text=replace_text, Separators=",")
text_split_4 = TextSplit(Text=text_split_2, Separators="\"")  # -> simplify(Result)
list_item = ListItem(List=text_split_3, Index=0, Wrap=True)  # -> Item, Item1, Item2, Item3
trim_tree = TrimTree(Tree=text_split_4, Depth=1)
panel_4 = Panel(list_item.Item)
panel_5 = Panel(list_item.Item1)
panel_6 = Panel(list_item.Item2)
panel_7 = Panel(list_item.Item3)
list_item_2 = ListItem(List=trim_tree, Index="4", Wrap=True)
list_item_3 = ListItem(List=flatten(list_item_2), Index=0, Wrap=True)  # -> Item, Item1
download_openstreetmap_osm = DownloadOpenStreetMapOSM(
    LeftBound=panel_5,
    RightBound=panel_7,
    TopBound=panel_6,
    BottomBound=panel_4,
    FilePath=assets_folder,
    RunToggle=Toggle(True))  # -> OSMQueryURL, OSMFilePath
construct_point = ConstructPoint(XCoordinate=list_item_3.Item, YCoordinate=list_item_3.Item1, ZCoordinate=0)
import_osm_features = ImportOSMFeatures(OSMPathOrURL=download_openstreetmap_osm.OSMQueryURL, OSMFeatureType="building", Format="xml", ImportAltitude=False)  # -> Points, Metadata, UTMZone, TranslationVector
import_osm_features_2 = ImportOSMFeatures(OSMPathOrURL=download_openstreetmap_osm.OSMQueryURL, OSMFeatureType="amenity", Format="xml", ImportAltitude=False)  # -> Points, Metadata, UTMZone, TranslationVector
import_osm_features_3 = ImportOSMFeatures(OSMPathOrURL=download_openstreetmap_osm.OSMQueryURL, OSMFeatureType="street", Format="xml", ImportAltitude=False)  # -> Points, Metadata, UTMZone, TranslationVector
polyline = PolyLine(Vertices=import_osm_features_3.Points, Closed=False)
polyline_2 = PolyLine(Vertices=import_osm_features.Points, Closed=False)
create_street_network = CreateStreetNetwork(
    StreetCurves=flatten(polyline),
    Metadata=flatten(import_osm_features_3.Metadata),
    SplitStreetCurves=True,
    UTMZone=import_osm_features_3.UTMZone,
    TranslationVector=import_osm_features_3.TranslationVector)  # -> StreetNetwork, StreetSegmentCurves, UTMZone, TranslationVector
create_amenity = CreateAmenity(PointLocationOfAmenity=import_osm_features_2.Points, Metadata=import_osm_features_2.Metadata)
polyline_offset = PolylineOffset(
    Polylines=polyline,
    Distance=Slider(5, range=0..10),
    Plane=Plane(origin=(0, 0, 0), x=(0, 0, 0), y=(0, 0, 0)),
    Tolerance=0.001,
    ClosedFillet=1,
    OpenFillet=1,
    Miter=2)  # -> Contour, Holes
arrange_amenities_by_building = ArrangeAmenitiesByBuilding(Amenities=flatten(create_amenity), Buildings=flatten(polyline_2))  # -> AmenitiesByBuilding, Buildings
region_union = RegionUnion(Curves=flatten(polyline_offset.Contour))
cull_index_4 = CullIndex(List=region_union, Indices="0", Wrap=True)
min_block_size_sqm = Slider(1035, range=0..10000)
area = Area(Geometry=cull_index_4)  # -> Area, Centroid
create_building = CreateBuilding(
    BuildingCurve=polyline_2,
    Metadata=import_osm_features.Metadata,
    AmenitiesInBuilding=arrange_amenities_by_building.AmenitiesByBuilding)
smaller_than = SmallerThan(FirstNumber=area.Area, SecondNumber=min_block_size_sqm)  # -> SmallerThan, OrEqualTo
build_urbano_model = BuildUrbanoModel(Buildings=flatten(create_building), StreetNetwork=create_street_network.StreetNetwork, BuildToggle=True)  # -> UrbanoModel, BuildingCurves, Activities
cull_pattern = CullPattern(List=cull_index_4, CullPattern=invert(smaller_than.SmallerThan))
max_block_size_sqm = Slider(8000, range=0..10000)
area_2 = Area(Geometry=cull_pattern)  # -> Area, Centroid
inspect_building = InspectBuilding(Building=build_urbano_model.BuildingCurves, DefaultHeight=10)  # -> Geometry, Metadata, Amenity, BuildingMesh
larger_than = LargerThan(FirstNumber=area_2.Area, SecondNumber=max_block_size_sqm)  # -> LargerThan, OrEqualTo
cull_pattern_2 = CullPattern(List=cull_pattern, CullPattern=invert(larger_than.LargerThan))
bounding_box = BoundingBox(Content=flatten(build_urbano_model.BuildingCurves), Plane=PlaneXY(0, 0, 0), UnionBox=True)  # -> Box, Box_2
area_3 = Area(Geometry=cull_pattern_2)  # -> Area, Centroid
unit_z = UnitZ(Factor=1)
boundary_surfaces = BoundarySurfaces(Edges=cull_pattern_2)
evaluate_surface = EvaluateSurface(Surface=reparameterize(bounding_box.Box), Point=construct_point)  # -> Point, Normal, UDirection, VDirection, Frame
point = Point(area_3.Centroid)
extrude = Extrude(Base=boundary_surfaces, Direction=unit_z)
closest_point = ClosestPoint(Point=evaluate_surface.Point, Cloud=flatten(point))  # -> ClosestPoint, CPIndex, Distance
router = Router(
    RouterUrbanoModelOrStreetNetwork=build_urbano_model.UrbanoModel,
    Origin=closest_point.ClosestPoint,
    Destination=create_amenity,
    TravelMode="pedestrian",
    TimeLimit=-1)  # -> Trip, Route, simplify(Time), Distance
list_item_4 = ListItem(List=extrude, Index=closest_point.CPIndex, Wrap=True)
cull_index_5 = CullIndex(List=extrude, Indices=closest_point.CPIndex, Wrap=True)
max_walk_time_mins = Slider(7.2, range=0..45)
smaller_than_2 = SmallerThan(FirstNumber=router.Time, SecondNumber=max_walk_time_mins)  # -> SmallerThan, OrEqualTo
trip_walkscore = TripWalkscore(Trip=router.Trip)  # -> flatten(Walkscore)
sort_list = SortList(Keys=trip_walkscore)  # -> Keys, ValuesValuesA
dispatch = Dispatch(List=router.Trip, DispatchPattern=smaller_than_2.OrEqualTo)  # -> ListA, ListB
list_item_5 = ListItem(List=sort_list.Keys, Index=0, Wrap=True)  # -> Item1, Item
average = Average(Input=sort_list.Keys)
inspect_trip = InspectTrip(Trip=dispatch.ListA)  # -> Origin, Destination, Time, Distance, Route, Mode, People, Activity, Amenity
panel_8 = Panel("""{
    "maxWalkScore": MaxWalk,
    "minWalkScore": MinWalk,
    "meanWalkScore": MeanWalk
  }""")
geometry = Geometry(inspect_trip.Route)
replace_text_2 = ReplaceText(Text=panel_8, Find="MaxWalk", Replace=list_item_5.Item1, RecursiveReplace=False)
replace_text_3 = ReplaceText(Text=replace_text_2, Find="MinWalk", Replace=list_item_5.Item, RecursiveReplace=False)
replace_text_4 = ReplaceText(Text=replace_text_3, Find="MeanWalk", Replace=average, RecursiveReplace=False)
write_text_file = WriteTextFile(Path=assets_folder, FileName="mapAnalysis.json", Data=replace_text_4, Write=Toggle(True))
meshbasicmaterial = MeshBasicMaterial(Color=ColourSwatch(SwatchColor=RGB(34, 91, 153)))
linebasicmaterial = LineBasicMaterial(Color=ColourSwatch(SwatchColor=RGB(0, 0, 0)), LineWidth=Slider(1.5, range=0..10))
meshbasicmaterial_2 = MeshBasicMaterial(Color=ColourSwatch(SwatchColor=RGB(57, 227, 133)))
meshbasicmaterial_3 = MeshBasicMaterial(Color=ColourSwatch(SwatchColor=RGB(68, 76, 87)))
mesh = Mesh(Mesh=cull_index_5, Material=meshbasicmaterial, DecimalAccuracy=3)
mesh_2 = Mesh(Mesh=list_item_4, Material=meshbasicmaterial_2, DecimalAccuracy=3)
mesh_3 = Mesh(Mesh=inspect_building.BuildingMesh, Material=meshbasicmaterial_3, DecimalAccuracy=3)
line = Line(Line=polyline, LineMaterial=linebasicmaterial, DecimalAccuracy=3)
compile_scene = CompileScene(Objects=flatten([mesh_3, line, mesh_2, mesh]))
boolean_toggle = BooleanToggle(True)
serializeobject = SerializeObject(Object3d=compile_scene, Minify=boolean_toggle, Run=boolean_toggle)
write_text_file_2 = WriteTextFile(Path=assets_folder, FileName="map.json", Data=serializeobject, Write=boolean_toggle)
