# Grasshopper definition wavy_fins_2.gh (Grasshopper 1.0.7)
# plug-ins: ShapeDiverForGrasshopper, Pufferfish, LunchBox, Triceratops, Bifocals, Parakeet

sddp = ShapeDiverDocumentPayload({AbsoluteTolerance=0, AngleTolerance=0, DistanceDisplayPrecision=0, GltfVersion="Gltf2", InputGroups="{}", OutputGroups="{}", RelativeTolerance=0, UnitSystem=0, VersionCreated="1.13.1.0", VersionSaved="1.13.1.0"})
honeybee = Honeybee_Honeybee()  # -> out; plug-in component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
ladybug = Ladybug_Ladybug()  # -> out; plug-in component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
file_path = FilePath("C:\Uni\2024\Term 2\CODE2132\sabri-web-page\web-page\assets\config.json")
read_file = ReadFile(File=file_path, PerLineParse=True)
panel = Panel(honeybee)
panel_2 = Panel(read_file)
panel_3 = Panel("""0
-1""")
cull_index = CullIndex(List=panel_2, Indices=panel_3, Wrap=True)
panel_4 = Panel(cull_index)
text_split = TextSplit(Text=panel_4, Separators=":")
standardmat = MeshStandardMaterial(
    Color=flatten(ColourSwatch(SwatchColor=RGB(180, 193, 204))),
    Opacity=1,
    Roughness=1,
    Metalness=Slider(0.5, range=0..1),
    Emissive=RGB(0, 0, 0),
    EmissiveIntensity=1)
standardmat_2 = MeshStandardMaterial(
    Color=flatten(ColourSwatch(SwatchColor=RGB(128, 119, 111))),
    Opacity=1,
    Roughness=1,
    Metalness=0.5,
    Emissive=RGB(0, 0, 0),
    EmissiveIntensity=1)
standardmat_3 = MeshStandardMaterial(
    Color=flatten(ColourSwatch(SwatchColor=RGB(43, 195, 255))),
    Opacity=Slider(0.55, range=0..1),
    Roughness=1,
    Metalness=Slider(0, range=0..100),
    Emissive=RGB(0, 0, 0),
    EmissiveIntensity=1)
replace_text = ReplaceText(Text=text_split, Find="\"", RecursiveReplace=False)
replace_text_2 = ReplaceText(Text=replace_text, Find=",", RecursiveReplace=False)
replace_text_3 = ReplaceText(Text=replace_text_2, Find=" ", RecursiveReplace=False)  # -> simplify(Result)
panel_5 = Panel(replace_text_3)
list_item = ListItem(List=panel_5, Index="1", Wrap=True)  # -> flatten(Item)

# ---- group: FLOOR HEIGHT
list_item_2 = ListItem(List=list_item, Index=0, Wrap=True)

# ----
unit_z = UnitZ(Factor=list_item_2)

# ---- group: ATTRACTOR PT STRENGTH
list_item_3 = ListItem(List=list_item, Index="4", Wrap=True)

# ---- group: FLOOR NUM
list_item_4 = ListItem(List=list_item, Index="1", Wrap=True)

# ---- group: ATTRACTOR PT SEED
list_item_5 = ListItem(List=list_item, Index="2", Wrap=True)

# ---- group: ATTRACTOR PT STRENGTH
list_item_6 = ListItem(List=list_item, Index="3", Wrap=True)

# ----
runanalysis = Boolean(list_item_3)
floor_height = Slider(1.5, range=0..10)
floor_num = Slider(16, range=0..100)
base_curve = Curve(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)
panel_6 = Panel("https://climate.onebuilding.org/WMO_Region_5_Southwest_Pacific/AUS_Australia/NSW_New_South_Wales/AUS_NSW_Sydney.Obs-Observatory.Hill.947680_TMYx.2007-2021.zip")
series = Series(Start=0, Step=list_item_2, Count=list_item_4)
unit_z_2 = UnitZ(Factor=series)
downloadepw = LBDownloadWeather(weather_URL=panel_6)  # -> epw_file, stat_file, ddy_file; plug-in component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
move = Move(Geometry=base_curve, Motion=unit_z_2)  # -> Geometry, Transform
number_slider = Slider(200, range=0..1000)
wea = HBWeaFromEPW(epw_file=downloadepw.epw_file)  # -> wea; plug-in component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
divide_curve = DivideCurve(Curve=move.Geometry, Count=number_slider, Kinks=False)  # -> Points, Tangents, Parameters
list_length = ListLength(List=move.Geometry)
flip_matrix = FlipMatrix(Data=divide_curve.Points)
division = Division(A=list_length, B="2")
polyline = PolyLine(Vertices=flip_matrix, Closed=False)  # -> simplify(Polyline)
list_item_7 = ListItem(List=move.Geometry, Index=division, Wrap=True)

number_slider_2 = Slider(15, range=0..100)
area = Area(Geometry=list_item_7)  # -> Area, Centroid
divide_curve_2 = DivideCurve(Curve=list_item_7, Count=number_slider_2, Kinks=False)  # -> Points, Tangents, Parameters
construct_domain = ConstructDomain(DomainStart=Slider(1, range=0..5), DomainEnd=Slider(8, range=0..10))
vector_2pt = Vector2Pt(PointA=area.Centroid, PointB=divide_curve_2.Points, Unitize=False)  # -> Vector, Length
random = Random(Range=construct_domain, Number=number_slider_2, Seed=list_item_5)
amplitude = Amplitude(Vector=vector_2pt.Vector, Amplitude=random)
construct_domain_2 = ConstructDomain(DomainStart=Slider(-8, range=-10..10), DomainEnd=Slider(8, range=-10..10))
move_2 = Move(Geometry=divide_curve_2.Points, Motion=amplitude)  # -> Geometry, Transform
random_2 = Random(Range=construct_domain_2, Number=number_slider_2, Seed=list_item_5)
unit_z_3 = UnitZ(Factor=random_2)
move_3 = Move(Geometry=move_2.Geometry, Motion=unit_z_3)  # -> Geometry, Transform
interpolate = Interpolate(Vertices=move_3.Geometry, Degree=3, Periodic=Toggle(True), KnotStyle=1)  # -> Curve, Length, Domain

boolean_toggle = BooleanToggle(True)
attractor_pt_random_seed = Slider(0, range=0..100)
file_path_2 = FilePath("C:\Uni\2024\Term 2\CODE2132\sabri-web-page\web-page\assets\")
mesh = Mesh()
panel_7 = Panel(file_path_2)
divide_curve_3 = DivideCurve(Curve=polyline, Count=floor_num, Kinks=False)  # -> simplify(Points), Tangents, Parameters
area_2 = Area(Geometry=move.Geometry)  # -> Area, Centroid
divide_curve_4 = DivideCurve(Curve=interpolate.Curve, Count=number_slider, Kinks=False)  # -> Points, Tangents, Parameters
line = Line(StartPoint=graft(divide_curve_4.Points), EndPoint=simplify(divide_curve_3.Points))  # -> simplify(Line)
attractor_point_strength = Slider(0.12, range=0.1..0.5)
length = Length(Curve=line)
multiplication = Multiplication(A=length, B=list_item_6)
vector_2pt_2 = Vector2Pt(PointA=area_2.Centroid, PointB=divide_curve_3.Points, Unitize=False)  # -> Vector, Length
amplitude_2 = Amplitude(Vector=vector_2pt_2.Vector, Amplitude=multiplication)
move_4 = Move(Geometry=divide_curve_3.Points, Motion=amplitude_2)  # -> Geometry, Transform
polyline_2 = PolyLine(Vertices=move_4.Geometry, Closed=False)  # -> simplify(Polyline)

number_slider_3 = Slider(50, range=0..1000)
loft = Loft(Curves=move.Geometry, Options={Adjust=False, Closed=False, LoftEnds=0, LoftSimp=0, LoftType=0, Rebuild=10, Refit=0.01})
quad_panels = QuadPanels(Surface=loft, UDivisions=10, VDivisions=number_slider_3)
custom_preview = CustomPreview(Geometry=quad_panels, Material=ColourSwatch(SwatchColor=RGBA(43, 195, 255, 136)))

loft_2 = Loft(
    Curves=[polyline_2, polyline],
    Options={Adjust=False, Closed=False, LoftEnds=0, LoftSimp=0, LoftType=0, Rebuild=10, Refit=0.01})
number_slider_4 = Slider(0.1, range=0..0.1)
offset_surface = OffsetSurface(Surface=loft_2, Distance=number_slider_4, BothSides=number_slider_4, CreateSolid=True)
custom_preview_2 = CustomPreview(Geometry=offset_surface, Material=ColourSwatch(SwatchColor=RGB(148, 148, 148)))

boundary_surfaces = BoundarySurfaces(Edges=move.Geometry)
custom_preview_3 = CustomPreview(Geometry=boundary_surfaces, Material=ColourSwatch(SwatchColor=RGB(128, 114, 102)))

area_3 = Area(Geometry=quad_panels)  # -> Area, Centroid
area_4 = Area(Geometry=quad_panels)  # -> Area, Centroid
unit_z_4 = UnitZ(Factor=Slider(0.5, range=0..1))
mesh_brep = MeshBrep(
    Brep=offset_surface,
    Settings={GridMaxCount=0, GridMinCount=16, JaggedSeams=False, MaxEdgeLength=0, MinEdgeLength=0.0001, MinTolerance=0, Refine=True, RefineAngle=0, RelativeTolerance=0.65, SimplePlanes=True, Tolerance=0})
fins = Mesh(mesh_brep)
mesh_2 = Mesh(Mesh=flatten(fins), Name="meshStandardMaterial", Material=standardmat, DecimalAccuracy=3)
scale = Scale(Geometry=quad_panels, Center=area_3.Centroid, Factor=Slider(0.98, range=0..1))  # -> Geometry, Transform
deconstruct_brep = DeconstructBrep(Brep=scale.Geometry)  # -> Faces, simplify(Edges), Vertices
number_slider_5 = Slider(0.1, range=0..0.1)
list_item_8 = ListItem(List=deconstruct_brep.Edges, Index=0, Wrap=True)  # -> Item1, Item
split_list = SplitList(List=flatten(list_item_8.Item1), Index=number_slider_3)  # -> ListA, ListB
offset_surface_2 = OffsetSurface(Surface=quad_panels, Distance=number_slider_5, Retrim=True)
offset_surface_3 = OffsetSurface(Surface=scale.Geometry, Distance=number_slider_5, Retrim=True)
area_5 = Area(Geometry=loft_2)  # -> flatten(Area), Centroid
join_curves_plus = JoinCurvesPlus(Curves=split_list.ListA, Tolerance=Slider(0.1, range=0..10), Preserve=False)
project = Project(Geometry=join_curves_plus, Plane=PlaneXY(0, 0, 0))  # -> Geometry, Transform
move_5 = Move(Geometry=project.Geometry, Motion=unit_z_2)  # -> Geometry, Transform
merge = Merge(Data1=project.Geometry, Data2=move_5.Geometry)
cull_index_2 = CullIndex(List=merge, Indices="-1", Wrap=True)  # -> flatten(List)
boundary_surfaces_2 = BoundarySurfaces(Edges=cull_index_2)  # -> flatten(Surfaces)
extrude = Extrude(Base=boundary_surfaces_2, Direction=unit_z)

# ---- group: rooms (closed brep)
# Geometry Preparation
geo = Geometry(extrude)
panel_8 = Panel("ScrapeDaSky")
roomsolid = HBRoomFromSolid(geo=flatten(geo), name=panel_8, conditioned=True)  # -> report, rooms; plug-in component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

# ---- group: boolean toggle for run analysis from website
boolean = Boolean(Toggle(False))
cull_pattern = CullPattern(List=roomsolid.rooms, CullPattern=boolean)

# ---- group: glazing (windows)
glassmod = HBGlassModifier(name="g_material", trans="0.8")  # -> modifier; plug-in component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
geometry = Geometry(scale.Geometry)
aperture = HBAperture(geo=geometry, name=panel_8, rad_mod=glassmod)  # -> report, apertures; plug-in component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
addsubface = HBAddSubface(hb_obj=flatten(cull_pattern), sub_faces=flatten(aperture.apertures))  # -> hb_obj; plug-in component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

# ----
boolean_2 = Boolean(boolean)
end_points = EndPoints(Curve=split_list.ListA)  # -> Start, End
extrude_2 = Extrude(Base=boundary_surfaces, Direction=unit_z_4)
list_length_2 = ListLength(List=area_4.Area)  # -> flatten(Length)
mass_addition = MassAddition(Input=flatten(area_4.Area))  # -> Result, PartialResults
mesh_brep_2 = MeshBrep(
    Brep=offset_surface_3,
    Settings={GridMaxCount=0, GridMinCount=16, JaggedSeams=False, MaxEdgeLength=0, MinEdgeLength=0.0001, MinTolerance=0, Refine=True, RefineAngle=0, RelativeTolerance=0.65, SimplePlanes=True, Tolerance=0})
glazing = Mesh(mesh_brep_2)
mesh_3 = Mesh(Mesh=flatten(glazing), Name="meshStandardWireframe", Material=standardmat_3, DecimalAccuracy=3)
mesh_brep_3 = MeshBrep(
    Brep=offset_surface_2,
    Settings={GridMaxCount=0, GridMinCount=16, JaggedSeams=False, MaxEdgeLength=0, MinEdgeLength=0.0001, MinTolerance=0, Refine=True, RefineAngle=0, RelativeTolerance=0.65, SimplePlanes=True, Tolerance=0})
glazing_frames = Mesh(mesh_brep_3)
polyline_3 = PolyLine(Vertices=end_points.Start, Closed=Toggle(True))
mass_addition_2 = MassAddition(Input=area_5.Area)  # -> Result, PartialResults
list_length_3 = ListLength(List=area_5.Area)
mesh_brep_4 = MeshBrep(
    Brep=extrude_2,
    Settings={GridMaxCount=0, GridMinCount=16, JaggedSeams=False, MaxEdgeLength=0, MinEdgeLength=0.0001, MinTolerance=0, Refine=True, RefineAngle=0, RelativeTolerance=0.65, SimplePlanes=True, Tolerance=0})
floors = Mesh(mesh_brep_4)
mesh_4 = Mesh(Mesh=flatten(floors), Name="meshStandardWireframe", Material=standardmat_2, DecimalAccuracy=3)
scene = CompileScene(Objects=flatten([mesh_2, mesh_3, mesh_4]))

# ---- group: shading (surrounding buildings, facade devices)
geometry_2 = Geometry(flatten([fins, floors, glazing_frames]))
shade = HBShade(geo=geometry_2)  # -> report, shades; plug-in component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

# ----
# Model + Grids
number_slider_6 = Slider(5, range=0..10)
gridrooms = HBSensorGridFromRooms(rooms=addsubface, grid_size=number_slider_6)  # -> grid, points, mesh; plug-in component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
model = HBModel(
    rooms=flatten(cull_pattern),
    shades=flatten(shade.shades),
    apertures=flatten(aperture.apertures),
    name="sample_model_grid")  # -> report, model; plug-in component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
vizwiref = HBVizualizeWireframe(hb_objs=flatten(model.model))  # -> geo; plug-in component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
assigngridsviews = HBAssignGridsAndViews(model=model.model, grids=flatten(gridrooms.grid))  # -> model; plug-in component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

# ----
# Annual Daylight
annualdaylight = HBAnnualDaylight(model=assigngridsviews, wea=wea, run=boolean_2)  # -> out, results, DA, cDA, UDI, UDI_low, UDI_up; plug-in component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
mjoin = MeshJoin(Meshes=gridrooms.mesh)
data = Data(flatten(annualdaylight.DA))
heatmap = LBSpatialHeatmap(values=data, mesh=mjoin)  # -> mesh, legend, title, colors, legend_par, vis_set; plug-in component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

serialize = SerializeObject(Object3d=scene, Minify=Toggle(True), Run=boolean_toggle)

# ---- group: coloured mesh to json
meshcolorfaces = MeshColorFaces(Mesh=heatmap.mesh, Color=heatmap.colors)
meshvertexcolors = MeshVertexColors(Mesh=meshcolorfaces, Name="analysis mesh", DecimalAccuracy=3)

# ----
writetxt = WriteTextFile(Path=file_path_2, FileName="facade.json", Data=serialize, Write=boolean_toggle)

boolean_toggle_2 = BooleanToggle(True)
scene_2 = CompileScene(Objects=flatten(meshvertexcolors))
serialize_2 = SerializeObject(Object3d=scene_2, Minify=boolean_toggle_2, Run=boolean_toggle_2)
writetxt_2 = WriteTextFile(Path=file_path_2, FileName="analysis_mesh.json", Data=serialize_2, Write=boolean_toggle_2)

price_sqm = Panel("970")
co2e_sqm = Panel("118.3")
round = Round(Number=mass_addition_2.Result)  # -> Nearest, Floor, Ceiling
price_sqm_2 = Panel("330")
multiplication_2 = Multiplication(A=mass_addition.Result, B=price_sqm)
multiplication_3 = Multiplication(A=mass_addition.Result, B=co2e_sqm)
co2e_sqm_2 = Panel("6.15")
round_2 = Round(Number=multiplication_2)  # -> Nearest, Floor, Ceiling
round_3 = Round(Number=multiplication_3)  # -> Nearest, Floor, Ceiling
multiplication_4 = Multiplication(A=round.Ceiling, B=co2e_sqm_2)
multiplication_5 = Multiplication(A=round.Ceiling, B=price_sqm_2)
round_4 = Round(Number=multiplication_4)  # -> Nearest, Floor, Ceiling
number_of_panels = Panel(list_length_2)
total_cost_glass = Panel(round_2.Ceiling)
total_carbon_glass = Panel(round_3.Ceiling)
panel_9 = Panel("""{
"number of glass panes": "panelsx",
"total cost of panels": "panelscostx",
"total embodied carbon of panels": "panelscarbonx",
"number of metal fins": "finsx",
"total cost of metal fins": "finscostx",
"total embodied carbon of fins": "finscarbonx"
}""")
number_of_fins = Panel(list_length_3)
total_cost_fins = Panel(multiplication_5)
total_carbon_fins = Panel(round_4.Ceiling)
replace_text_4 = ReplaceText(Text=panel_9, Find="panelsx", Replace=number_of_panels, RecursiveReplace=False)
replace_text_5 = ReplaceText(Text=replace_text_4, Find="panelscostx", Replace=total_cost_glass, RecursiveReplace=False)
replace_text_6 = ReplaceText(Text=replace_text_5, Find="panelscarbonx", Replace=total_carbon_glass, RecursiveReplace=False)
replace_text_7 = ReplaceText(Text=replace_text_6, Find="finsx", Replace=number_of_fins, RecursiveReplace=False)
replace_text_8 = ReplaceText(Text=replace_text_7, Find="finscostx", Replace=total_cost_fins, RecursiveReplace=False)
replace_text_9 = ReplaceText(Text=replace_text_8, Find="finscarbonx", Replace=total_carbon_fins, RecursiveReplace=False)
write_text_file = WriteTextFile(Path=file_path_2, FileName="analysis_data.json", Data=replace_text_9, Write=Toggle(True))
